# Dynamo graph Building Generator - Imperial.dyn "Building Generator - Sandbox" (Dynamo 2.0.2.6826)

# group: Input
building_type = IntegerSlider(0, range=0..8 step 1)
length = DoubleSlider(53, range=1..100 step 1)
width = DoubleSlider(55, range=1..100 step 1)
depth = DoubleSlider(15, range=1..50 step 1)
total_floor_area = DoubleSlider(19300, range=0..50000 step 100)
floor_height = DoubleSlider(9, range=1..20 step 0.1)
curved = BoolSelector(false)
cores = BoolSelector(true)
hallway_to_depth_ratio = DoubleSlider(0.2, range=0..1 step 0.1)
core_size_floors = DoubleSlider(5, range=0..20 step 1)
core_size_floor_area = DoubleSlider(0.1, range=0..1 step 0.1)
code_block = CodeBlock()
# ---------- code_block.designscript (6 lines) ----------
[
	Point.ByCoordinates(80, 0),
	Point.ByCoordinates(0, 80),
	Point.ByCoordinates(-80, 0),
	Point.ByCoordinates(0, -50)
];
# ----------------------------------------
boolean = BoolSelector(true)
setback = DoubleSlider(10, range=0..50 step 1)
max_height = DoubleSlider(100, range=0..500 step 10)
code_block_2 = CodeBlock { [30, 15]; [40, 10]; }
byOriginRadii = Ellipse.ByOriginRadii(xAxisRadius=code_block_2.out0, yAxisRadius=code_block_2.out1)
total_floor_area_2 = DoubleSlider(38200, range=0..50000 step 100)
floor_height_2 = DoubleSlider(9, range=1..20 step 0.1)

selectBuildingType = GenerativeToolkit.Building.SelectBuildingType(ShapeIndex=building_type)
buildingGenerator = GenerativeToolkit.Building.BuildingGenerator(Type=selectBuildingType, Length=length, Width=width, Depth=depth, BldgArea=total_floor_area, FloorHeight=floor_height, IsCurved=curved, CreateCore=cores, HallwayToDepth=hallway_to_depth_ratio, CoreSizeFactorFloors=core_size_floors, CoreSizeFactorArea=core_size_floor_area)
bySolid = PolySurface.BySolid(solid=buildingGenerator.BuildingSolid)
siteContext = GenerativeToolkit.Site.SiteContext(RevitSite=bySolid)
watch = Watch(siteContext.Heights)
byPoints = PolyCurve.ByPoints(points=code_block, connectLastToFirst=boolean)

# group: Site
siteMassGenerator = GenerativeToolkit.Site.SiteMassGenerator(SiteOutline=byPoints, Setback=setback, HeightLimit=max_height)
siteClashTest = GenerativeToolkit.Site.SiteClashTest(BuildingMass=buildingGenerator.BuildingSolid, SiteMass=siteMassGenerator.SiteMass)
watch_2 = Watch(siteClashTest.Percent)

angle_threshold = DoubleSlider(45, range=0..90 step 1)
deceonstructFacadeShell = GenerativeToolkit.Building.DeceonstructFacadeShell(Mass=buildingGenerator.BuildingSolid, AngleThreshold=angle_threshold)

# group: Display
color_palette = ColorPalette({R: 255, G: 255, B: 255, A: 90})
byGeometryColor = Modifiers.GeometryColor.ByGeometryColor(geometry=deceonstructFacadeShell.VerticalSurfaces, color=color_palette)
join = List.Join(list0=deceonstructFacadeShell.HorizontalSurfaces, list1=buildingGenerator.NetFloors)
color_palette_2 = ColorPalette({R: 0, G: 255, B: 255, A: 143})
byGeometryColor_2 = Modifiers.GeometryColor.ByGeometryColor(geometry=join@L1, color=color_palette_2)
toCuboid = BoundingBox.ToCuboid(boundingBox=siteContext.BoundingBoxes)
edges = Topology.Edges(topology=toCuboid)
curveGeometry = Edge.CurveGeometry(edge=edges)
color_palette_3 = ColorPalette({R: 0, G: 0, B: 0, A: 133})
byGeometryColor_3 = Modifiers.GeometryColor.ByGeometryColor(geometry=curveGeometry, color=color_palette_3)
edges_2 = Topology.Edges(topology=siteClashTest.BuildingOutside)
curveGeometry_2 = Edge.CurveGeometry(edge=edges_2)
color_palette_4 = ColorPalette({R: 255, G: 0, B: 0, A: 255})
byGeometryColor_4 = Modifiers.GeometryColor.ByGeometryColor(geometry=curveGeometry_2, color=color_palette_4)
edges_3 = Topology.Edges(topology=siteMassGenerator.SiteMass)
curveGeometry_3 = Edge.CurveGeometry(edge=edges_3)
color_palette_5 = ColorPalette({R: 0, G: 0, B: 255, A: 31})
byGeometryColor_5 = Modifiers.GeometryColor.ByGeometryColor(geometry=curveGeometry_3, color=color_palette_5)
color_palette_6 = ColorPalette({R: 255, G: 0, B: 255, A: 255})
byGeometryColor_6 = Modifiers.GeometryColor.ByGeometryColor(geometry=buildingGenerator.Cores, color=color_palette_6)

buildingGeneratorByCurves = GenerativeToolkit.Building.BuildingGeneratorByCurves(EdgeLoops=byOriginRadii, BldgArea=total_floor_area_2, FloorHeight=floor_height_2)

# group: Revit
categories = Categories(index=276)
createRevitMass = GenerativeToolkit.Revit.CreateRevitMass(BuildingSolid=buildingGenerator.BuildingSolid, Category=categories)
floor_types = FloorTypes(index=5)
createRevitFloors = GenerativeToolkit.Revit.CreateRevitFloors(Floors=buildingGenerator.NetFloors, FloorType=floor_types)
