# Dynamo graph Building Generator - Revit - Imperial.dyn (Dynamo 2.0.2.6826)

code_block = CodeBlock { [30, 15]; }
code_block_2 = CodeBlock { [40, 10]; }
byOriginRadii = Ellipse.ByOriginRadii(xAxisRadius=code_block, yAxisRadius=code_block_2)
total_floor_area = DoubleSlider(38200, range=0..50000 step 100)
floor_height = DoubleSlider(9, range=1..20 step 0.1)
buildingGeneratorByCurves = GenerativeToolkit.Buildings.BuildingGeneratorByCurves(EdgeLoops=byOriginRadii, BldgArea=total_floor_area, FloorHeight=floor_height)
bySolid = PolySurface.BySolid(solid=buildingGeneratorByCurves.BuildingSolid)
siteContext = GenerativeToolkit.Site.SiteContext(RevitSite=bySolid)
watch = Watch(siteContext.Heights)
code_block_3 = CodeBlock()
# ---------- code_block_3.designscript (6 lines) ----------
[
	Point.ByCoordinates(80, 0),
	Point.ByCoordinates(0, 80),
	Point.ByCoordinates(-80, 0),
	Point.ByCoordinates(0, -50)
];
# ----------------------------------------
boolean = BoolSelector(true)
byPoints = PolyCurve.ByPoints(points=code_block_3, connectLastToFirst=boolean)
setback = DoubleSlider(10, range=0..50 step 1)
max_height = DoubleSlider(100, range=0..500 step 10)
siteMassGenerator = GenerativeToolkit.Site.SiteMassGenerator(SiteOutline=byPoints, Setback=setback, HeightLimit=max_height)
siteClashTest = GenerativeToolkit.Site.SiteClashTest(BuildingMass=buildingGeneratorByCurves.BuildingSolid, SiteMass=siteMassGenerator.SiteMass)
watch_2 = Watch(siteClashTest.Percent)
angle_threshold = DoubleSlider(45, range=0..90 step 1)
deceonstructFacadeShell = GenerativeToolkit.Buildings.DeceonstructFacadeShell(Mass=buildingGeneratorByCurves.BuildingSolid, AngleThreshold=angle_threshold)
color_palette = ColorPalette({R: 255, G: 255, B: 255, A: 90})
byGeometryColor = Modifiers.GeometryColor.ByGeometryColor(geometry=deceonstructFacadeShell.VerticalSurfaces, color=color_palette)
join = List.Join(list0=deceonstructFacadeShell.HorizontalSurfaces, list1=buildingGeneratorByCurves.NetFloors)
color_palette_2 = ColorPalette({R: 0, G: 255, B: 255, A: 143})
byGeometryColor_2 = Modifiers.GeometryColor.ByGeometryColor(geometry=join@L1, color=color_palette_2)
toCuboid = BoundingBox.ToCuboid(boundingBox=siteContext.BoundingBoxes)
edges = Topology.Edges(topology=toCuboid)
curveGeometry = Edge.CurveGeometry(edge=edges)
color_palette_3 = ColorPalette({R: 0, G: 0, B: 0, A: 133})
byGeometryColor_3 = Modifiers.GeometryColor.ByGeometryColor(geometry=curveGeometry, color=color_palette_3)
edges_2 = Topology.Edges(topology=siteClashTest.BuildingOutside)
curveGeometry_2 = Edge.CurveGeometry(edge=edges_2)
color_palette_4 = ColorPalette({R: 255, G: 0, B: 0, A: 255})
byGeometryColor_4 = Modifiers.GeometryColor.ByGeometryColor(geometry=curveGeometry_2, color=color_palette_4)
edges_3 = Topology.Edges(topology=siteMassGenerator.SiteMass)
curveGeometry_3 = Edge.CurveGeometry(edge=edges_3)
color_palette_5 = ColorPalette({R: 0, G: 0, B: 255, A: 31})
byGeometryColor_5 = Modifiers.GeometryColor.ByGeometryColor(geometry=curveGeometry_3, color=color_palette_5)
color_palette_6 = ColorPalette({R: 255, G: 0, B: 255, A: 255})
byGeometryColor_6 = Modifiers.GeometryColor.ByGeometryColor(geometry=buildingGeneratorByCurves.Cores, color=color_palette_6)
code_block_4 = CodeBlock(x=setback) { -x; }
offset = Curve.Offset(curve=byPoints, distance=code_block_4)
XY = Plane.XY()
building_type = IntegerSlider(0, range=0..8 step 1)
selectBuildingType = GenerativeToolkit.Buildings.SelectBuildingType(ShapeIndex=building_type)
length = DoubleSlider(53, range=1..100 step 1)
width = DoubleSlider(55, range=1..100 step 1)
depth = DoubleSlider(15, range=1..50 step 1)
total_floor_area_2 = DoubleSlider(19300, range=0..50000 step 100)
floor_height_2 = DoubleSlider(9, range=1..20 step 0.1)
curved = BoolSelector(true)
cores = BoolSelector(false)
hallway_to_depth_ratio = DoubleSlider(0.2, range=0..1 step 0.1)
core_size_floors = DoubleSlider(5, range=0..20 step 1)
core_size_floor_area = DoubleSlider(0.1, range=0..1 step 0.1)
buildingGenerator = GenerativeToolkit.Buildings.BuildingGenerator(BasePlane=XY, Type=selectBuildingType, Length=length, Width=width, Depth=depth, BldgArea=total_floor_area_2, FloorHeight=floor_height_2, IsCurved=curved, CreateCore=cores, HallwayToDepth=hallway_to_depth_ratio, CoreSizeFactorFloors=core_size_floors, CoreSizeFactorArea=core_size_floor_area)
floor_types = FloorTypes(index=5)
createRevitFloors = GenerativeToolkit.Revit.CreateRevitFloors(Floors=buildingGenerator.Floors, FloorType=floor_types)
categories = Categories(index=276)
createRevitMass = GenerativeToolkit.Revit.CreateRevitMass(BuildingSolid=buildingGenerator.BuildingSolid, Category=categories)
