# Dynamo graph Building Generator.dyn (Dynamo 2.0.2.6826)

XY = Plane.XY()
building_type = IntegerSlider(0, range=0..8 step 1)
selectBuildingType = Buildings.Creation.SelectBuildingType(ShapeIndex=building_type)
length = DoubleSlider(26000, range=0..50000 step 1000)
width = DoubleSlider(27000, range=0..50000 step 1000)
depth = DoubleSlider(10000, range=0..30000 step 1000)
total_floor_area = DoubleSlider(2909, range=0..10000 step 1)
code_block = CodeBlock(x=total_floor_area) { x*1000000; }
floor_height = DoubleSlider(3000, range=0..40000 step 1000)
curved = BoolSelector(false)
cores = BoolSelector(false)
hallway_to_depth_ratio = DoubleSlider(0.2, range=0..1 step 0.1)
core_size_floors = DoubleSlider(5, range=0..20 step 1)
code_block_2 = CodeBlock(x=core_size_floors) { x*1000000; }
core_size_floor_area = DoubleSlider(0.1, range=0..1 step 0.1)
buildingGenerator = Buildings.Creation.BuildingGenerator(BasePlane=XY, Type=selectBuildingType, Length=length, Width=width, Depth=depth, BldgArea=code_block, FloorHeight=floor_height, IsCurved=curved, CreateCore=cores, HallwayToDepth=hallway_to_depth_ratio, CoreSizeFactorFloors=code_block_2, CoreSizeFactorArea=core_size_floor_area)
bySolid = PolySurface.BySolid(solid=buildingGenerator.BuildingSolid)
siteContext = Site.Analysis.SiteContext(RevitSite=bySolid)
watch = Watch(siteContext.Heights)
code_block_3 = CodeBlock()
# ---------- code_block_3.designscript (6 lines) ----------
[
	Point.ByCoordinates(30000, 0),
	Point.ByCoordinates(0, 30000),
	Point.ByCoordinates(-30000, 0),
	Point.ByCoordinates(0, -18000)
];
# ----------------------------------------
boolean = BoolSelector(true)
byPoints = PolyCurve.ByPoints(points=code_block_3, connectLastToFirst=boolean)
setback = DoubleSlider(3000, range=0..20000 step 1000)
max_height = DoubleSlider(40000, range=0..500000 step 1000)
siteMassGenerator = Site.Creation.SiteMassGenerator(SiteOutline=byPoints, Setback=setback, HeightLimit=max_height)
siteClashTest = Site.Analysis.SiteClashTest(BuildingMass=buildingGenerator.BuildingSolid, SiteMass=siteMassGenerator.SiteMass)
watch_2 = Watch(siteClashTest.Percent)
categories = Categories(index=276)
createRevitMass = Revit.ElementCreation.CreateRevitMass(BuildingSolid=buildingGenerator.BuildingSolid, Category=categories)
floor_types = FloorTypes(index=5)
createRevitFloors = Revit.ElementCreation.CreateRevitFloors(Floors=buildingGenerator.Floors, FloorType=floor_types)
angle_threshold = DoubleSlider(45, range=0..90 step 1)
deceonstructFacadeShell = Buildings.Analysis.DeceonstructFacadeShell(Mass=buildingGenerator.BuildingSolid, AngleThreshold=angle_threshold)
color_palette = ColorPalette({R: 255, G: 255, B: 255, A: 90})
byGeometryColor = Modifiers.GeometryColor.ByGeometryColor(geometry=deceonstructFacadeShell.VerticalSurfaces, color=color_palette)
join = List.Join(list0=deceonstructFacadeShell.HorizontalSurfaces, list1=buildingGenerator.NetFloors)
color_palette_2 = ColorPalette({R: 0, G: 255, B: 255, A: 143})
byGeometryColor_2 = Modifiers.GeometryColor.ByGeometryColor(geometry=join@L1, color=color_palette_2)
toCuboid = BoundingBox.ToCuboid(boundingBox=siteContext.BoundingBoxes)
edges = Topology.Edges(topology=toCuboid)
curveGeometry = Edge.CurveGeometry(edge=edges)
color_palette_3 = ColorPalette({R: 0, G: 0, B: 0, A: 133})
byGeometryColor_3 = Modifiers.GeometryColor.ByGeometryColor(geometry=curveGeometry, color=color_palette_3)
edges_2 = Topology.Edges(topology=siteClashTest.BuildingOutside)
curveGeometry_2 = Edge.CurveGeometry(edge=edges_2)
color_palette_4 = ColorPalette({R: 255, G: 0, B: 0, A: 255})
byGeometryColor_4 = Modifiers.GeometryColor.ByGeometryColor(geometry=curveGeometry_2, color=color_palette_4)
edges_3 = Topology.Edges(topology=siteMassGenerator.SiteMass)
curveGeometry_3 = Edge.CurveGeometry(edge=edges_3)
color_palette_5 = ColorPalette({R: 0, G: 0, B: 255, A: 31})
byGeometryColor_5 = Modifiers.GeometryColor.ByGeometryColor(geometry=curveGeometry_3, color=color_palette_5)
color_palette_6 = ColorPalette({R: 255, G: 0, B: 255, A: 255})
byGeometryColor_6 = Modifiers.GeometryColor.ByGeometryColor(geometry=buildingGenerator.Cores, color=color_palette_6)
