# Dynamo graph dt_GenerativeToolkit_Binpacking2DTest_BSSF.dyn (Dynamo 2.0.2.6826)

# note: Variables / Inputs
# Green indicates Variables that can be altered per project and must be set accordingly before running the script.
# note: Working / Functions
# Orange indicates the working of the script. No changes should be made in these groups unless advised.
# note: Checking / Outputs
# Red indicates checking nodes to ensure the script has deployed correctly.

# group: GENERATIVE TOOLKIT Bin Packing 2D - Best Short Side Fits
# note: DYNAMO VERSION
# 2.0.2
# note: REQUIRED DYNAMO PACKAGES
# GenerativeToolkit
# note: ADDITIONAL COMMENTS
# note: DYNAMO PROJECT
# Generative Design Toolkit
# note: ASSOCIATED FILE(S)
# N/A
# note: AUTHOR(S) / CREATION DATE
# designtech.io for Autodesk Refinery Team / April 2018
# note: DESCRIPTION
# Example file showing how the 2D bin packing node works with the Best Short Side Fits Algorithm, with different sorting methods.
# Bin packing is helpful when trying to fit a collection of rectangles inside another rectangle. For example when placing rooms in a floor plan.

# group: Rectangle properties
amount_of_rectangles = CodeBlock { amount = 100; }
min_and_max_dimension_of = CodeBlock { min = 0.5; max = 15; }  # "Min and Max dimension of rectangles"

# group: Random Rectangles
randomList = Math.RandomList(amount=amount_of_rectangles)
remapRange = Math.RemapRange(numbers=randomList, newMin=min_and_max_dimension_of.min, newMax=min_and_max_dimension_of.max)
shuffle = List.Shuffle(list=remapRange)
byWidthLength = Rectangle.ByWidthLength(width=remapRange, length=shuffle)

# group: Rectangles Area
code_block = CodeBlock(r=byWidthLength) { area = r.Width * r.Height; }

# group: Sort Ascending
sortByKey = List.SortByKey(list=byWidthLength, keys=code_block)

# group: Sort Descending
reverse = List.Reverse(list=sortByKey.sorted_list)

# group: Bin Properties
size_of_bin = CodeBlock { width = 50; height = 50; }

# group: Placement Method
# note: GenerativeToolkit
bestShortSideFits = Autodesk.RefineryToolkits.SpacePlanning.Generate.BinPacking_PlacementMethods.BestShortSideFits()

# group: Best Short Side Fits - Decending Order
code_block_2 = CodeBlock { 150; -120; }
byOrigin = CoordinateSystem.ByOrigin(x=code_block_2.out0, y=code_block_2.out1)
byWidthLength_2 = Rectangle.ByWidthLength(cs=byOrigin, width=size_of_bin.width, length=size_of_bin.height)
# note: GenerativeToolkit
pack2D = Autodesk.RefineryToolkits.SpacePlanning.Generate.BinPacking.Pack2D(rects=reverse, bin=byWidthLength_2, placementMethod=bestShortSideFits)
code_block_3 = CodeBlock(r=pack2D.packedRectangles) { area = r.Width * r.Height; }
sum = Math.Sum(values=code_block_3)

# group: Best Short Side Fits - Ascending Order
code_block_4 = CodeBlock { 150; -60; }
byOrigin_2 = CoordinateSystem.ByOrigin(x=code_block_4.out0, y=code_block_4.out1)
byWidthLength_3 = Rectangle.ByWidthLength(cs=byOrigin_2, width=size_of_bin.width, length=size_of_bin.height)
# note: GenerativeToolkit
pack2D_2 = Autodesk.RefineryToolkits.SpacePlanning.Generate.BinPacking.Pack2D(rects=sortByKey.sorted_list, bin=byWidthLength_3, placementMethod=bestShortSideFits)
code_block_5 = CodeBlock(r=pack2D_2.packedRectangles) { area = r.Width * r.Height; }
sum_2 = Math.Sum(values=code_block_5)

# group: Best Short Side Fits - Custom Order
code_block_6 = CodeBlock { 150; }
byOrigin_3 = CoordinateSystem.ByOrigin(x=code_block_6)
byWidthLength_4 = Rectangle.ByWidthLength(cs=byOrigin_3, width=size_of_bin.width, length=size_of_bin.height)
# note: GenerativeToolkit
pack2D_3 = Autodesk.RefineryToolkits.SpacePlanning.Generate.BinPacking.Pack2D(rects=byWidthLength, bin=byWidthLength_4, placementMethod=bestShortSideFits)
code_block_7 = CodeBlock(r=pack2D_3.packedRectangles) { area = r.Width * r.Height; }
sum_3 = Math.Sum(values=code_block_7)

# group: Color
list_create = List.Create(item0=pack2D.packedRectangles, item1=pack2D_2.packedRectangles, item2=pack2D_3.packedRectangles)
byPatch = Surface.ByPatch(closedCurve=list_create)
code_block_8 = CodeBlock { 120; 0; 0; 255; }
byARGB = Color.ByARGB(a=code_block_8.out0, r=code_block_8.out1, g=code_block_8.out2, b=code_block_8.out3)
byGeometryColor = Modifiers.GeometryColor.ByGeometryColor(geometry=byPatch, color=byARGB)

bin_area = CodeBlock(binWidth=size_of_bin.width, binHeight=size_of_bin.height) { binWidth*binHeight; }

# group: Best Short Side Fits Results - Custom Order
count = List.Count(list=pack2D_3.packedRectangles)
watch = Watch(count)
code_block_9 = CodeBlock(packedArea=sum_3, binArea=bin_area) { 100*packedArea/binArea; }
watch_2 = Watch(code_block_9)

# group: Best Short Side Fits Results - Ascending Order
count_2 = List.Count(list=pack2D_2.packedRectangles)
watch_3 = Watch(count_2)
code_block_10 = CodeBlock(packedArea=sum_2, binArea=bin_area) { 100*packedArea/binArea; }
watch_4 = Watch(code_block_10)

# group: Best Short Side Fits Results - Decending Order
count_3 = List.Count(list=pack2D.packedRectangles)
watch_5 = Watch(count_3)
code_block_11 = CodeBlock(packedArea=sum, binArea=bin_area) { 100*packedArea/binArea; }
watch_6 = Watch(code_block_11)
