# Dynamo graph dt_GenerativeToolkit_Binpacking3DTest.dyn (Dynamo 2.0.2.6826)

# note: Get Cuboid offset from plane
# note: Working / Functions
# Orange indicates the working of the script. No changes should be made in these groups unless advised.
# note: Checking / Outputs
# Red indicates checking nodes to ensure the script has deployed correctly.

# group: GENERATIVE TOOLKIT Bin Packing 3D
# note: DYNAMO VERSION
# 2.0.2
# note: REQUIRED DYNAMO PACKAGES
# GenerativeToolkit
# note: ADDITIONAL COMMENTS
# note: DYNAMO PROJECT
# Generative Design Toolkit
# note: ASSOCIATED FILE(S)
# N/A
# note: AUTHOR(S) / CREATION DATE
# designtech.io for Autodesk Refinery Team / April 2018
# note: DESCRIPTION
# This graph shows the workflow of setting up the 3D bin packing.

# group: Bin dimensions
bin_dimensions = CodeBlock { length = 500; width = 400; height = 300; }

# group: Visualize Bin
byCoordinates = Point.ByCoordinates(x=bin_dimensions.length, y=bin_dimensions.width, z=bin_dimensions.height)
byCorners = Cuboid.ByCorners(highPoint=byCoordinates)
edges = Topology.Edges(topology=byCorners)
curveGeometry = Edge.CurveGeometry(edge=edges)

# group: Create Bin
byLengths = Cuboid.ByLengths(width=bin_dimensions.width, length=bin_dimensions.length, height=bin_dimensions.height)

# group: Item Dimensions
# note: Variables / Inputs
# Green indicates Variables that can be altered per project and must be set accordingly before running the script.
code_block = CodeBlock()
# ---------- code_block.designscript (3 lines) ----------
width = [100,200,100,300,150,200,100,200,250];
length = [200,200,150,200,200,100,150,150,200];
height = [100,250,300,350,500,100,200,200,300];
# ----------------------------------------

# group: Create Items
byLengths_2 = Cuboid.ByLengths(width=code_block.width, length=code_block.length, height=code_block.height)

# group: GenerativeToolkit - Binpacking3D
pack3D = Autodesk.RefineryToolkits.SpacePlanning.Generate.BinPacking.Pack3D(bin=byLengths, items=byLengths_2)
watch = Watch(pack3D.packedItems)
watch_2 = Watch(pack3D.packedIndices)

# group: Visualize Packed Items
identity = Object.Identity(obj=pack3D.packedItems)
edges_2 = Topology.Edges(topology=identity)
curveGeometry_2 = Edge.CurveGeometry(edge=edges_2)

# group: Get Cuboids offset from plane
code_block_2 = CodeBlock(cuboid1=byLengths_2)
# ---------- code_block_2.designscript (6 lines) ----------
face1 = Autodesk.Topology.Faces(cuboid1);
t2 = DSCore.List.GetItemAtIndex(face1<1L>, 1);
vertex1 = Autodesk.Face.Vertices(t2);
point1 = DesignScript.Vertex.PointGeometry(vertex1);
t3 = DesignScript.Point.Z(point1);
t4 = DSCore.List.GetItemAtIndex(t3<1L>, 1);
# ----------------------------------------

# group: Translate Cuboids to plane and color Packed Items Green and Unpacked Items Red
byOrigin = CoordinateSystem.ByOrigin(z=code_block_2.t4)
code_block_3 = CodeBlock { 1000..#9..250; 250; }
byCoordinates_2 = Point.ByCoordinates(x=code_block_3.out0, y=code_block_3.out1, lacing=CrossProduct)
byOrigin_2 = CoordinateSystem.ByOrigin(origin=byCoordinates_2)
transform = Geometry.Transform(geometry=byLengths_2, fromCoordinateSystem=byOrigin, contextCoordinateSystem=byOrigin_2)
getItemAtIndex = List.GetItemAtIndex(list=transform, index=pack3D.packedIndices)
color_palette = ColorPalette({R: 154, G: 205, B: 50, A: 255})
byGeometryColor = Modifiers.GeometryColor.ByGeometryColor(geometry=getItemAtIndex, color=color_palette)
setDifference = List.SetDifference(list1=transform, list2=getItemAtIndex)
color_palette_2 = ColorPalette({R: 255, G: 0, B: 0, A: 255})
byGeometryColor_2 = Modifiers.GeometryColor.ByGeometryColor(geometry=setDifference, color=color_palette_2)
