# Dynamo graph GenerativeToolkit_DistinctColorsTest.dyn (Dynamo 2.11.1.4675)
# packages: Refinery Toolkit 1.1.1

# note: Display / Validation
# Logic used simply for visualization purposes, does not contain core logic.
# note: Working / Functions
# Core Workings of the Dynamo Graph
# note: Variables / Inputs
# Variables that can be altered per project and must be set accordingly before running the graph.

# group: REFINERY SPACE PLANNING TOOLKIT Contrasty Color Generator
# note: DYNAMO VERSION
# 2.0.2
# note: REQUIRED DYNAMO PACKAGES
# Refinery Toolkit
# note: ADDITIONAL COMMENTS
# note: DYNAMO PROJECT
# Refinery Toolkit
# note: ASSOCIATED FILE(S)
# N/A
# note: AUTHOR(S) / CREATION DATE
# designtech.io for Autodesk Refinery Team / April 2019
# note: DESCRIPTION
# This workflow shows how to use the ContrastyColorRange node in the Refinery Toolkit

# group: ContrastyColorRange Inputs
amount = CodeBlock { 19; }
# note: Remember / Gate Nodes
# Data that needs to be cached from Dynamo for Revit is stored here.
brightness_1_to_1 = DoubleSlider(0, range=-1..1 step 0.1)
seed = CodeBlock { 1; }

# group: Test Surface
# note: Checking / Outputs
# Orange indicates checking nodes to ensure the script has deployed correctly.
code_block = CodeBlock(amount=amount) { 0..#amount..12.5; }
byCoordinates = Point.ByCoordinates(x=code_block)
byOrigin = CoordinateSystem.ByOrigin(origin=byCoordinates)
code_block_2 = CodeBlock { 10; }
byWidthLength = Rectangle.ByWidthLength(cs=byOrigin, width=code_block_2, length=code_block_2)
byPatch = Surface.ByPatch(closedCurve=byWidthLength)

# group: Refinery Toolkit - Create Distinct colors (Max 19 colors)
contrastyColorRange = Autodesk.RefineryToolkits.SpacePlanning.Explore.Colors.ContrastyColorRange(amount=amount, brightness=brightness_1_to_1, seed=seed)

# group: Distict colors
byGeometryColor = Modifiers.GeometryColor.ByGeometryColor(geometry=byPatch, color=contrastyColorRange)
