# Dynamo graph GenerativeToolkit_GeometricMedianTest.dyn (Dynamo 2.11.1.4675)
# packages: Refinery Toolkit 1.1.1

# note: Display / Validation
# Logic used simply for visualization purposes, does not contain core logic.
# note: Remember / Gate Nodes
# Data that needs to be cached from Dynamo for Revit is stored here.
# note: Working / Functions
# Core Workings of the Dynamo Graph
# note: Variables / Inputs
# Variables that can be altered per project and must be set accordingly before running the graph.

# group: REFINERY SPACE PLANNING TOOLKIT Geometric Median
# note: DYNAMO VERSION
# 2.0.2
# note: REQUIRED DYNAMO PACKAGES
# Refinery Toolkit
# note: ADDITIONAL COMMENTS
# note: DYNAMO PROJECT
# Refinery Toolkit
# note: ASSOCIATED FILE(S)
# N/A
# note: AUTHOR(S) / CREATION DATE
# designtech.io for Autodesk Refinery Team / April 2019
# note: DESCRIPTION
# This graph show examples of how the GeometricMedian node finds the point in a set of sample points, that minimizes the distance to all other points. The example shows this with different shaps and sample points.
# The GeometricMedian can be used to find the optimal location where the goal is to minimize distance to a set of objects.

# group: 50 Random points
# note: Checking / Outputs
# Orange indicates checking nodes to ensure the script has deployed correctly.
code_block = CodeBlock { 50; }
randomList = Math.RandomList(amount=code_block)
code_block_2 = CodeBlock { 2; 50; }
remapRange = Math.RemapRange(numbers=randomList, newMin=code_block_2.out0, newMax=code_block_2.out1)
shuffle = List.Shuffle(list=remapRange)
byCoordinates = Point.ByCoordinates(x=remapRange, y=shuffle)

# group: Obtuse Triangle
code_block_3 = CodeBlock { [70,95,130]; [20,12,-18]; }
byCoordinates_2 = Point.ByCoordinates(x=code_block_3.out0, y=code_block_3.out1)
byPoints = Polygon.ByPoints(points=byCoordinates_2)

# group: Acute Triangle
code_block_4 = CodeBlock { [70,95,80]; [50,42,18]; }
byCoordinates_3 = Point.ByCoordinates(x=code_block_4.out0, y=code_block_4.out1)
byPoints_2 = Polygon.ByPoints(points=byCoordinates_3)

# group: One of the four points is inside the triangle formed by the other three points
code_block_5 = CodeBlock { [70,95,80,60]; [80,72,48,90]; }
byCoordinates_4 = Point.ByCoordinates(x=code_block_5.out0, y=code_block_5.out1)
byPoints_3 = Polygon.ByPoints(points=byCoordinates_4)

# group: Convex Quadrilateral
code_block_6 = CodeBlock { [40,65,50,30]; [80,72,55,55]; }
byCoordinates_5 = Point.ByCoordinates(x=code_block_6.out0, y=code_block_6.out1)
byPoints_4 = Polygon.ByPoints(points=byCoordinates_5)

# group: Refinery Toolkit - Geometric Median
geometricMedianOfPoints = Autodesk.RefineryToolkits.SpacePlanning.Analyze.Adjacency.GeometricMedianOfPoints(points=byCoordinates)
geometricMedianOfPoints_2 = Autodesk.RefineryToolkits.SpacePlanning.Analyze.Adjacency.GeometricMedianOfPoints(points=byCoordinates_2)
geometricMedianOfPoints_3 = Autodesk.RefineryToolkits.SpacePlanning.Analyze.Adjacency.GeometricMedianOfPoints(points=byCoordinates_3)
geometricMedianOfPoints_4 = Autodesk.RefineryToolkits.SpacePlanning.Analyze.Adjacency.GeometricMedianOfPoints(points=byCoordinates_4)
geometricMedianOfPoints_5 = Autodesk.RefineryToolkits.SpacePlanning.Analyze.Adjacency.GeometricMedianOfPoints(points=byCoordinates_5)

# group: Vizualize Geometric Median
list_create = List.Create(item0=geometricMedianOfPoints, item1=geometricMedianOfPoints_2, item2=geometricMedianOfPoints_3, item3=geometricMedianOfPoints_4, item4=geometricMedianOfPoints_5)
code_block_7 = CodeBlock { 1; }
byCenterPointRadius = Circle.ByCenterPointRadius(centerPoint=list_create, radius=code_block_7, lacing=Longest)

# group: Visualize Lines
byStartPointEndPoint = Line.ByStartPointEndPoint(startPoint=geometricMedianOfPoints, endPoint=byCoordinates, lacing=Longest)
code_block_8 = CodeBlock { 75; 255; 0; 0; }
byARGB = Color.ByARGB(alpha=code_block_8.out0, red=code_block_8.out1, green=code_block_8.out2, blue=code_block_8.out3)
byGeometryColor = Modifiers.GeometryColor.ByGeometryColor(geometry=byStartPointEndPoint, color=byARGB)

# group: Visualize Lines
equals = List.Equals(object=byCoordinates_2@L1, otherObject=geometricMedianOfPoints_2)
filterByBoolMask = List.FilterByBoolMask(list=byCoordinates_2, mask=equals)
byStartPointEndPoint_2 = Line.ByStartPointEndPoint(startPoint=geometricMedianOfPoints_2, endPoint=filterByBoolMask.out, lacing=Longest)
code_block_9 = CodeBlock { 75; 255; 0; 0; }
byARGB_2 = Color.ByARGB(alpha=code_block_9.out0, red=code_block_9.out1, green=code_block_9.out2, blue=code_block_9.out3)
byGeometryColor_2 = Modifiers.GeometryColor.ByGeometryColor(geometry=byStartPointEndPoint_2, color=byARGB_2)

# group: Visualize Lines
byStartPointEndPoint_3 = Line.ByStartPointEndPoint(startPoint=geometricMedianOfPoints_3, endPoint=byCoordinates_3, lacing=Longest)
code_block_10 = CodeBlock { 75; 255; 0; 0; }
byARGB_3 = Color.ByARGB(alpha=code_block_10.out0, red=code_block_10.out1, green=code_block_10.out2, blue=code_block_10.out3)
byGeometryColor_3 = Modifiers.GeometryColor.ByGeometryColor(geometry=byStartPointEndPoint_3, color=byARGB_3)

# group: Visualize Lines
equals_2 = List.Equals(object=byCoordinates_4@L1, otherObject=geometricMedianOfPoints_4)
filterByBoolMask_2 = List.FilterByBoolMask(list=byCoordinates_4, mask=equals_2)
byStartPointEndPoint_4 = Line.ByStartPointEndPoint(startPoint=geometricMedianOfPoints_4, endPoint=filterByBoolMask_2.out, lacing=Longest)
code_block_11 = CodeBlock { 75; 255; 0; 0; }
byARGB_4 = Color.ByARGB(alpha=code_block_11.out0, red=code_block_11.out1, green=code_block_11.out2, blue=code_block_11.out3)
byGeometryColor_4 = Modifiers.GeometryColor.ByGeometryColor(geometry=byStartPointEndPoint_4, color=byARGB_4)

# group: Visualize Lines
byStartPointEndPoint_5 = Line.ByStartPointEndPoint(startPoint=geometricMedianOfPoints_5, endPoint=byCoordinates_5, lacing=Longest)
code_block_12 = CodeBlock { 75; 255; 0; 0; }
byARGB_5 = Color.ByARGB(alpha=code_block_12.out0, red=code_block_12.out1, green=code_block_12.out2, blue=code_block_12.out3)
byGeometryColor_5 = Modifiers.GeometryColor.ByGeometryColor(geometry=byStartPointEndPoint_5, color=byARGB_5)
