# Dynamo graph GenerativeToolkit_OpenessTest(RVT).dyn (Dynamo 2.10.1.3976)
# packages: Refinery Toolkit for Space Planning 0.0.1

# group: Get Desk point
family_types = FamilyTypes("M_Desk:1525 x 762mm")
all_elements_of_family_type = ElementsOfFamilyType(Family_Type=family_types)
getLocation = Element.GetLocation(element=all_elements_of_family_type)

# group: Get object dimensions
elementType = Element.ElementType(element=all_elements_of_family_type)
code_block = CodeBlock { "Depth"; "Width"; }
getParameterValueByName = Element.GetParameterValueByName(element=elementType, parameterName=code_block.out1)
getParameterValueByName_2 = Element.GetParameterValueByName(element=elementType, parameterName=code_block.out0)

# group: Surface by object
byOrigin = CoordinateSystem.ByOrigin(origin=getLocation)
ZAxis = Vector.ZAxis()
facingOrientation = FamilyInstance.FacingOrientation(familyInstance=all_elements_of_family_type)
XAxis = Vector.XAxis()
ZAxis_2 = Vector.ZAxis()
angleAboutAxis = Vector.AngleAboutAxis(vector=facingOrientation, otherVector=XAxis, rotationAxis=ZAxis_2)
code_block_2 = CodeBlock(rotation=angleAboutAxis) { -rotation; }
rotate = CoordinateSystem.Rotate(coordinateSystem=byOrigin, origin=getLocation, axis=ZAxis, degrees=code_block_2)
byWidthLength = Rectangle.ByWidthLength(cs=rotate, width=getParameterValueByName, length=getParameterValueByName_2)

byPatch = Surface.ByPatch(closedCurve=byWidthLength)

# group: Obstacles- Column Polygons
code_block_3 = CodeBlock { Category.ByName("Columns"); }
all_elements_of_category = ElementsOfCategory(Category=code_block_3)
getLocation_2 = Element.GetLocation(element=all_elements_of_category)
byOrigin_2 = CoordinateSystem.ByOrigin(origin=getLocation_2)
elementType_2 = Element.ElementType(element=all_elements_of_category)
code_block_4 = CodeBlock { "Depth"; "Width"; }
getParameterValueByName_3 = Element.GetParameterValueByName(element=elementType_2, parameterName=code_block_4.out1)
getParameterValueByName_4 = Element.GetParameterValueByName(element=elementType_2, parameterName=code_block_4.out0)
byWidthLength_2 = Rectangle.ByWidthLength(cs=byOrigin_2, width=getParameterValueByName_3, length=getParameterValueByName_4)

# group: Obstacles- Wall Polygons
code_block_5 = CodeBlock { Category.ByName("Walls"); }
all_elements_of_category_2 = ElementsOfCategory(Category=code_block_5)
getLocation_3 = Element.GetLocation(element=all_elements_of_category_2)
elementType_3 = Element.ElementType(element=all_elements_of_category_2)
code_block_6 = CodeBlock { "Width"; }
getParameterValueByName_5 = Element.GetParameterValueByName(element=elementType_3, parameterName=code_block_6)
direction = Line.Direction(line=getLocation_3)
byThickeningCurve = PolyCurve.ByThickeningCurve(curve=getLocation_3, thickness=getParameterValueByName_5, nor=direction)
curves = PolyCurve.Curves(polyCurve=byThickeningCurve)
startPoint = Curve.StartPoint(curve=curves)
byPoints = Polygon.ByPoints(points=startPoint)

join = List.Join(list0=byWidthLength_2, list1=byPoints)

# group: Refinery Toolkit - Openess From Point
fromSurface = Autodesk.RefineryToolkits.SpacePlanning.Analyze.Openess.FromSurface(surface=byPatch, obstructions=join)
watch = Watch(fromSurface)
