# Dynamo graph GenerativeToolkit_OpennessTest.dyn (Dynamo 2.11.1.4675)
# packages: Refinery Toolkit 1.1.1

# note: Display / Validation
# Logic used simply for visualization purposes, does not contain core logic.
# note: Working / Functions
# Core Workings of the Dynamo Graph
# note: Variables / Inputs
# Variables that can be altered per project and must be set accordingly before running the graph.

# group: REFINERY SPACE PLANNING TOOLKIT Openness
# note: DYNAMO VERSION
# 2.0.2
# note: REQUIRED DYNAMO PACKAGES
# Refinery Toolkit
# note: ADDITIONAL COMMENTS
# note: DYNAMO PROJECT
# Refinery Toolkit
# note: ASSOCIATED FILE(S)
# N/A
# note: AUTHOR(S) / CREATION DATE
# designtech.io for Autodesk Refinery Team / April 2019
# note: DESCRIPTION
# This graph shows how to use the REFINERY SPACE PLANNING TOOLKITs Openness Node.
# The Node returns the openess score of any surface. The score is calculated by checking how much of the object parameter is enclosed by any input obstacle. A tolerance can be set to check for intersection with elements with a fixed distance to the object.
# For example this can be used in a desk layout workflow to optimize the placement of desks, bu either minimizing or mazimizing the openess score.

# group: Create Object Location
# note: Checking / Outputs
# Orange indicates checking nodes to ensure the script has deployed correctly.
# note: Remember / Gate Nodes
# Data that needs to be cached from Dynamo for Revit is stored here.
X = DoubleSlider(-6.898, range=-8.716..100 step 0.1)
Y = DoubleSlider(-1, range=-7.478..100 step 0.1)
origin_point_point_bycoordinates = Point.ByCoordinates(x=X, y=Y)
dimensions = CodeBlock { 2; 5; }
rotation = CodeBlock { 90; }

# group: Surface from of object
byOrigin = CoordinateSystem.ByOrigin(origin=origin_point_point_bycoordinates)
byWidthLength = Rectangle.ByWidthLength(cs=byOrigin, width=dimensions.out0, length=dimensions.out1)
ZAxis = Vector.ZAxis()
rotate = Geometry.Rotate(geometry=byWidthLength, origin=origin_point_point_bycoordinates, axis=ZAxis, degrees=rotation)
byPatch = Surface.ByPatch(closedCurve=rotate)

# group: Layout
code_block = CodeBlock { [0,-10,15,5]; [0,5,-7,5]; }
byCoordinates = Point.ByCoordinates(x=code_block.out0, y=code_block.out1)
byOrigin_2 = CoordinateSystem.ByOrigin(origin=byCoordinates)
code_block_2 = CodeBlock { [50,10,10,10]; [50,10,10,7]; }
byWidthLength_2 = Rectangle.ByWidthLength(cs=byOrigin_2, width=code_block_2.out0, length=code_block_2.out1)
deconstruct = List.Deconstruct(list=byWidthLength_2)

# group: Refinery Toolkit - Openess
fromSurface = Autodesk.RefineryToolkits.SpacePlanning.Analyze.Openess.FromSurface(surface=byPatch, boundary=deconstruct.rest, obstructions=deconstruct.first)
watch = Watch(fromSurface)
