# Dynamo graph GenerativeToolkit_PackingCuboids.dyn (Dynamo 2.11.1.4675)
# packages: Refinery Toolkit for Space Planning 0.0.1

# note: Checking / Outputs
# Orange indicates checking nodes to ensure the script has deployed correctly.
# note: Variables / Inputs
# Variables that can be altered per project and must be set accordingly before running the graph.

# group: REFINERY SPACE PLANNING TOOLKIT Packing Cuboids
# note: DYNAMO VERSION
# 2.0.2
# note: REQUIRED DYNAMO PACKAGES
# Refinery Toolkit
# note: ADDITIONAL COMMENTS
# note: DYNAMO PROJECT
# Refinery Toolkit
# note: ASSOCIATED FILE(S)
# N/A
# note: AUTHOR(S) / CREATION DATE
# designtech.io for Autodesk Refinery Team / April 2019
# note: DESCRIPTION
# This graph shows the workflow of setting up the 3D bin packing.

# group: Bin dimensions
bin_dimensions = CodeBlock { length = 500; width = 400; height = 300; }

# group: Create Bins
byLengths = Cuboid.ByLengths(width=bin_dimensions.width, length=bin_dimensions.length, height=bin_dimensions.height)

# group: Visualize Bin
edges = Topology.Edges(topology=byLengths)
curveGeometry = Edge.CurveGeometry(edge=edges)

# group: Item Dimensions
# note: Remember / Gate Nodes
# Data that needs to be cached from Dynamo for Revit is stored here.
# note: Working / Functions
# Core Workings of the Dynamo Graph
# note: Display / Validation
# Logic used simply for visualization purposes, does not contain core logic.
code_block = CodeBlock()
# ---------- code_block.designscript (3 lines) ----------
width = [100,200,100,300,150,200,100,200,250];
length = [200,200,150,200,200,100,150,150,200];
height = [100,250,300,350,500,100,200,200,300];
# ----------------------------------------

# group: Create Items
byLengths_2 = Cuboid.ByLengths(width=code_block.width, length=code_block.length, height=code_block.height)

# group: Refinery Toolkit - Packing Cuboids
packCuboids = Autodesk.RefineryToolkits.SpacePlanning.Generate.Packing.PackCuboids(items=byLengths_2, containers=byLengths)

# group: Results
packed_items = Watch(packCuboids.Packed_Items)
packed_indices = Watch(packCuboids.Packed_Indices)
container_packed = Watch(packCuboids.Container_Volume_Packed)
items_volume_packed_in_container = Watch(packCuboids.Item_Volume_Packed)

# group: Get Cuboids offset from plane
code_block_2 = CodeBlock(cuboid1=byLengths_2)
# ---------- code_block_2.designscript (6 lines) ----------
face1 = Autodesk.Topology.Faces(cuboid1);
t2 = DSCore.List.GetItemAtIndex(face1<1L>, 1);
vertex1 = Autodesk.Face.Vertices(t2);
point1 = DesignScript.Vertex.PointGeometry(vertex1);
t3 = DesignScript.Point.Z(point1);
t4 = DSCore.List.GetItemAtIndex(t3<1L>, 1);
# ----------------------------------------

# group: Translate Cuboids to plane and color Packed Items = Green Unpacked Items = Red
byOrigin = CoordinateSystem.ByOrigin(z=code_block_2.t4)
code_block_3 = CodeBlock { 1000..#9..250; 250; }
byCoordinates = Point.ByCoordinates(x=code_block_3.out0, y=code_block_3.out1, lacing=CrossProduct)
byOrigin_2 = CoordinateSystem.ByOrigin(origin=byCoordinates)
transform = Geometry.Transform(geometry=byLengths_2, fromCoordinateSystem=byOrigin, contextCoordinateSystem=byOrigin_2)
getItemAtIndex = List.GetItemAtIndex(list=transform, index=packCuboids.Packed_Indices)
color_palette = ColorPalette({R: 154, G: 205, B: 50, A: 255})
byGeometryColor = Modifiers.GeometryColor.ByGeometryColor(geometry=getItemAtIndex, color=color_palette)
setDifference = List.SetDifference(list1=transform, list2=getItemAtIndex)
color_palette_2 = ColorPalette({R: 255, G: 0, B: 0, A: 255})
byGeometryColor_2 = Modifiers.GeometryColor.ByGeometryColor(geometry=setDifference, color=color_palette_2)

# group: Visualize Packed Items
identity = Object.Identity(object=packCuboids.Packed_Items)
edges_2 = Topology.Edges(topology=identity)
curveGeometry_2 = Edge.CurveGeometry(edge=edges_2)
