# Dynamo graph GenerativeToolkit_PackingRectangles_BSSF.dyn (Dynamo 2.11.1.4675)
# packages: Refinery Toolkit 1.1.1

# note: Working / Functions
# Core Workings of the Dynamo Graph
# note: Variables / Inputs
# Variables that can be altered per project and must be set accordingly before running the graph.
# note: Display / Validation
# Logic used simply for visualization purposes, does not contain core logic.

# group: REFINERY SPACE PLANNING TOOLKIT Packing Rectangles Best Short Side Strategy
# note: DYNAMO VERSION
# 2.0.2
# note: REQUIRED DYNAMO PACKAGES
# Refinery Toolkit
# note: ADDITIONAL COMMENTS
# note: DYNAMO PROJECT
# Refinery Toolkit
# note: ASSOCIATED FILE(S)
# N/A
# note: AUTHOR(S) / CREATION DATE
# designtech.io for Autodesk Refinery Team / April 2019
# note: DESCRIPTION
# Example file showing how the 2D bin packing node works with the Best Best Area Fits Algorithm, with different sorting methods.
# Bin packing is helpful when trying to fit a collection of rectangles inside another rectangle. For example when placing rooms in a floor plan.

# group: Rectangle properties
# note: Remember / Gate Nodes
# Data that needs to be cached from Dynamo for Revit is stored here.
amount_of_rectangles = CodeBlock { amount = 100; }
min_and_max_dimension_of = CodeBlock { min = 0.5; max = 15; }  # "Min and Max dimension of rectangles"

# group: Random Rectangles
randomList = Math.RandomList(amount=amount_of_rectangles)
remapRange = Math.RemapRange(numbers=randomList, newMin=min_and_max_dimension_of.min, newMax=min_and_max_dimension_of.max)
shuffle = List.Shuffle(list=remapRange)
byWidthLength = Rectangle.ByWidthLength(width=remapRange, length=shuffle)

# group: Rectangles Area
code_block = CodeBlock(r=byWidthLength) { area = r.Width * r.Height; }

# group: Sort Ascending
sortByKey = List.SortByKey(list=byWidthLength, keys=code_block)

# group: Sort Descending
reverse = List.Reverse(list=sortByKey.sortedList)

# group: Bin Properties
# note: Checking / Outputs
# Orange indicates checking nodes to ensure the script has deployed correctly.
size_of_bin = CodeBlock { width = 50; height = 50; }

# group: Packing strategy
# note: Refinery Space Planning Toolkit
rectangleShortSideStrategy = Autodesk.RefineryToolkits.SpacePlanning.Generate.Packing.RectangleShortSideStrategy()

# group: Best Short Side Fits - Decending Order
code_block_2 = CodeBlock { 150; -120; }
byOrigin = CoordinateSystem.ByOrigin(x=code_block_2.out0, y=code_block_2.out1)
byWidthLength_2 = Rectangle.ByWidthLength(cs=byOrigin, width=size_of_bin.width, length=size_of_bin.height)
# note: Refinery Space Planning Toolkit
packRectangles = Autodesk.RefineryToolkits.SpacePlanning.Generate.Packing.PackRectangles(items=reverse, containers=byWidthLength_2, strategy=rectangleShortSideStrategy)
code_block_3 = CodeBlock(r=packRectangles.Packed_Items) { area = r.Width * r.Height; }
sum = Math.Sum(values=code_block_3)

# group: Best Short Side Fits - Ascending Order
code_block_4 = CodeBlock { 150; -60; }
byOrigin_2 = CoordinateSystem.ByOrigin(x=code_block_4.out0, y=code_block_4.out1)
byWidthLength_3 = Rectangle.ByWidthLength(cs=byOrigin_2, width=size_of_bin.width, length=size_of_bin.height)
# note: Refinery Space Planning Toolkit
packRectangles_2 = Autodesk.RefineryToolkits.SpacePlanning.Generate.Packing.PackRectangles(items=sortByKey.sortedList, containers=byWidthLength_3, strategy=rectangleShortSideStrategy)
code_block_5 = CodeBlock(r=packRectangles_2.Packed_Items) { area = r.Width * r.Height; }
sum_2 = Math.Sum(values=code_block_5)

# group: Best Short Side Fits - Custom Order
code_block_6 = CodeBlock { 150; }
byOrigin_3 = CoordinateSystem.ByOrigin(x=code_block_6)
byWidthLength_4 = Rectangle.ByWidthLength(cs=byOrigin_3, width=size_of_bin.width, length=size_of_bin.height)
# note: Refinery Space Planning Toolkit
packRectangles_3 = Autodesk.RefineryToolkits.SpacePlanning.Generate.Packing.PackRectangles(items=byWidthLength, containers=byWidthLength_4, strategy=rectangleShortSideStrategy)
code_block_7 = CodeBlock(r=packRectangles_3.Packed_Items) { area = r.Width * r.Height; }
sum_3 = Math.Sum(values=code_block_7)

# group: Color
list_create = List.Create(item0=packRectangles.Packed_Items, item1=packRectangles_2.Packed_Items, item2=packRectangles_3.Packed_Items)
byPatch = Surface.ByPatch(closedCurve=list_create)
code_block_8 = CodeBlock { 120; 0; 0; 255; }
byARGB = Color.ByARGB(alpha=code_block_8.out0, red=code_block_8.out1, green=code_block_8.out2, blue=code_block_8.out3)
byGeometryColor = Modifiers.GeometryColor.ByGeometryColor(geometry=byPatch, color=byARGB)

bin_area = CodeBlock(binWidth=size_of_bin.width, binHeight=size_of_bin.height) { binWidth*binHeight; }

# group: Best Short Side Fits Results - Custom Order
count = List.Count(list=packRectangles_3.Packed_Items)
watch = Watch(count)
code_block_9 = CodeBlock(packedArea=sum_3, binArea=bin_area) { 100*packedArea/binArea; }
watch_2 = Watch(code_block_9)

# group: Best Short Side Fits Results - Ascending Order
count_2 = List.Count(list=packRectangles_2.Packed_Items)
watch_3 = Watch(count_2)
code_block_10 = CodeBlock(packedArea=sum_2, binArea=bin_area) { 100*packedArea/binArea; }
watch_4 = Watch(code_block_10)

# group: Best Short Side Fits Results - Decending Order
count_3 = List.Count(list=packRectangles.Packed_Items)
watch_5 = Watch(count_3)
code_block_11 = CodeBlock(packedArea=sum, binArea=bin_area) { 100*packedArea/binArea; }
watch_6 = Watch(code_block_11)
