# Dynamo graph GenerativeToolkit_SurfaceDivisionTest.dyn (Dynamo 2.11.1.4675)
# packages: Refinery Toolkit 1.1.1

# note: Working / Functions
# Core Workings of the Dynamo Graph
# note: Variables / Inputs
# Variables that can be altered per project and must be set accordingly before running the graph.
# note: Display / Validation
# Logic used simply for visualization purposes, does not contain core logic.

# group: REFINERY SPACE PLANNING TOOLKIT Surface Division
# note: DYNAMO VERSION
# 2.0.2
# note: REQUIRED DYNAMO PACKAGES
# Refinery Toolkit
# note: ADDITIONAL COMMENTS
# note: DYNAMO PROJECT
# Refinery Toolkit
# note: ASSOCIATED FILE(S)
# N/A
# note: AUTHOR(S) / CREATION DATE
# designtech.io for Autodesk Refinery Team / April 2019
# note: DESCRIPTION
# The SurfaceDivision node will divide and split a surface based on U&V parameters

# group: Create Surface
# note: Checking / Outputs
# Orange indicates checking nodes to ensure the script has deployed correctly.
number_slider = DoubleSlider(27.129, range=0..100 step 0.1)
number_slider_2 = DoubleSlider(25.08, range=0..100 step 0.1)
# note: Remember / Gate Nodes
# Data that needs to be cached from Dynamo for Revit is stored here.
number_slider_3 = DoubleSlider(10.318, range=0..100 step 0.1)
number_slider_4 = DoubleSlider(36.351, range=0..100 step 0.1)
number_slider_5 = DoubleSlider(-7.419, range=-7.419..100 step 0.1)
number_slider_6 = DoubleSlider(16.573, range=0..100 step 0.1)
code_block = CodeBlock(t1=number_slider, t2=number_slider_2, t3=number_slider_3, t4=number_slider_4, t5=number_slider_5, t6=number_slider_6)
# ---------- code_block.designscript (11 lines) ----------
Surface.ByPatch(
	PolyCurve.ByPoints(
		[
			Point.ByCoordinates(0, 0, 0),
			Point.ByCoordinates(t1, t2, 0),
			Point.ByCoordinates(t3, t4, 0),
			Point.ByCoordinates(t5, t6, 0)
		],
		true
	)
);
# ----------------------------------------

# group: U&V Parameters
code_block_2 = CodeBlock { 0..1..#10; }

# group: Refinery Toolkit - Divide Surface
divideSurface = Autodesk.RefineryToolkits.SpacePlanning.Generate.SurfaceDivision2D.DivideSurface(surface=code_block, U=code_block_2, V=code_block_2)

# group: Color Divided Surface
code_block_3 = CodeBlock { 19; 0; 0; 0..1..#19; }
contrastyColorRange = Autodesk.RefineryToolkits.SpacePlanning.Explore.Colors.ContrastyColorRange(amount=code_block_3.out0, brightness=code_block_3.out1, seed=code_block_3.out2)
code_block_4 = CodeBlock(x=divideSurface) { 0..1..#DSCore.List.Count(x); }
color_range = ColorRange(colors=contrastyColorRange, indices=code_block_3.out3, value=code_block_4)
shuffle = List.Shuffle(list=color_range)
byGeometryColor = Modifiers.GeometryColor.ByGeometryColor(geometry=divideSurface, color=shuffle)
