# Dynamo graph GenerativeToolkit_Visibility_LinesTest(RefineryVersion).dyn (Dynamo 2.11.1.4675)
# packages: Refinery Toolkit for Space Planning 0.0.1

# note: Variables / Inputs
# Variables that can be altered per project and must be set accordingly before running the graph.
# note: Working / Functions
# Core Workings of the Dynamo Graph
# note: Display / Validation
# Logic used simply for visualization purposes, does not contain core logic.

# group: REFINERY SPACE PLANNING TOOLKIT Views To Outside
# note: DYNAMO VERSION
# 2.0.2
# note: REQUIRED DYNAMO PACKAGES
# Refinery Toolkit
# note: ADDITIONAL COMMENTS
# note: DYNAMO PROJECT
# Refinery Toolkit
# note: ASSOCIATED FILE(S)
# N/A
# note: AUTHOR(S) / CREATION DATE
# designtech.io for Autodesk Refinery Team / April 2019
# note: DESCRIPTION
# The Views To Outside node will calculate how big a precentage of a 360 view is to the outside. Outside is represented with line segments.

# group: Create Layout
# note: Checking / Outputs
# Orange indicates checking nodes to ensure the script has deployed correctly.
# note: Remember / Gate Nodes
# Data that needs to be cached from Dynamo for Revit is stored here.
code_block = CodeBlock { [0,-10,15,5]; [0,5,-7,5]; }
byCoordinates = Point.ByCoordinates(x=code_block.out0, y=code_block.out1)
byOrigin = CoordinateSystem.ByOrigin(origin=byCoordinates)
code_block_2 = CodeBlock { [50,10,10,10]; [50,10,10,7]; }
byWidthLength = Rectangle.ByWidthLength(cs=byOrigin, width=code_block_2.out0, length=code_block_2.out1)
deconstruct = List.Deconstruct(list=byWidthLength)

# group: Sample Point
byPatch = Surface.ByPatch(closedCurve=deconstruct.first)
in_uparameter_number_slider = DoubleSlider(0.01379814472, range=0.01..0.99 step 0.01)  # graph input
in_vparameter_number_slider = DoubleSlider(0.2820688266, range=0.01..0.99 step 0.01)  # graph input
pointAtParameter = Surface.PointAtParameter(surface=byPatch, u=in_uparameter_number_slider, v=in_vparameter_number_slider)

# group: Create window segments
code_block_3 = CodeBlock()
# ---------- code_block_3.designscript (16 lines) ----------
//Window 1
[0.01,0.05];
//Window 2
[0.14,0.18];
//Window 3
[0.3,0.36];
//Window 4
[0.41,0.46];
//Window 5
[0.55,0.59];
//Window 6
[0.64,0.69];
//Window 7
[0.78,0.83];
//Window 8
[0.87,0.93];
# ----------------------------------------
list_create = List.Create(item0=code_block_3.out0, item1=code_block_3.out1, item2=code_block_3.out2, item3=code_block_3.out3, item4=code_block_3.out4, item5=code_block_3.out5, item6=code_block_3.out6, item7=code_block_3.out7)
pointAtParameter_2 = Curve.PointAtParameter(curve=deconstruct.first, param=list_create)
code_block_4 = CodeBlock(point1=pointAtParameter_2) { startPt = DSCore.List.GetItemAtIndex(point1<1L>, 0); endPt = DSCore.List.GetItemAtIndex(point1<1L>, 1); }
byStartPointEndPoint = Line.ByStartPointEndPoint(startPoint=code_block_4.startPt, endPoint=code_block_4.endPt)

# group: Refinery Toolkit - View To Outside
ofLinesFromOrigin = Autodesk.RefineryToolkits.SpacePlanning.Analyze.Visibility.OfLinesFromOrigin(origin=pointAtParameter, targetLines=byStartPointEndPoint, boundary=deconstruct.first, obstructions=deconstruct.rest)
OUT_ViewsToOutsideScore_MAX = Watch(ofLinesFromOrigin.Percentage_visible)  # graph output

# group: Visualize views to outside
code_block_5 = CodeBlock(segments=ofLinesFromOrigin.Visible_items, origin=pointAtParameter)
# ---------- code_block_5.designscript (2 lines) ----------
segmentPoints = DSCore.List.Transpose([DesignScript.Curve.StartPoint(segments), DesignScript.Curve.EndPoint(segments)]);
viewLines = DesignScript.Line.ByStartPointEndPoint(origin, segmentPoints);
# ----------------------------------------
list_create_2 = List.Create(item0=ofLinesFromOrigin.Visible_items, item1=code_block_5.viewLines)
transpose = List.Transpose(lists=list_create_2)
flatten = List.Flatten(list=transpose, lacing=Longest)
byJoinedCurves = PolyCurve.ByJoinedCurves(curves=flatten)
byPatch_2 = Surface.ByPatch(closedCurve=byJoinedCurves)
color_palette = ColorPalette({R: 255, G: 255, B: 0, A: 255})
byGeometryColor = Modifiers.GeometryColor.ByGeometryColor(geometry=byPatch_2, color=color_palette)
identity = Object.Identity(object=code_block_5.segmentPoints)
