# Dynamo graph GenerativeToolkit_Visibility_PointsTest(RefineryVersion).dyn (Dynamo 2.11.1.4675)
# packages: Refinery Toolkit 1.1.1

# note: Variables / Inputs
# Variables that can be altered per project and must be set accordingly before running the graph.
# note: Working / Functions
# Core Workings of the Dynamo Graph
# note: Display / Validation
# Logic used simply for visualization purposes, does not contain core logic.

# group: REFINERY SPACE PLANNING TOOLKIT Visible Points
# note: DYNAMO VERSION
# 2.0.2
# note: REQUIRED DYNAMO PACKAGES
# Refinery Toolkit
# note: ADDITIONAL COMMENTS
# note: DYNAMO PROJECT
# Refinery Toolkit
# note: ASSOCIATED FILE(S)
# N/A
# note: AUTHOR(S) / CREATION DATE
# designtech.io for Autodesk Refinery Team / April 2019
# note: DESCRIPTION
# The VisiblePoints node will calculate the precentage of sample points that are visible from the origin point.
# For example this can be used to optimize the placement of any object that needs a high visibility to other objects or areas.

# group: Create Layout
byCoordinates = Point.ByCoordinates()
# note: Checking / Outputs
# Orange indicates checking nodes to ensure the script has deployed correctly.
number_slider = DoubleSlider(18, range=0..100 step 0.1)
# note: Remember / Gate Nodes
# Data that needs to be cached from Dynamo for Revit is stored here.
number_slider_2 = DoubleSlider(-10.5, range=-22.5..100 step 0.1)
byCoordinates_2 = Point.ByCoordinates(x=number_slider, y=number_slider_2)
number_slider_3 = DoubleSlider(-18, range=-20..100 step 0.1)
number_slider_4 = DoubleSlider(10.5, range=0..100 step 0.1)
byCoordinates_3 = Point.ByCoordinates(x=number_slider_3, y=number_slider_4)
list_create = List.Create(item0=byCoordinates, item1=byCoordinates, item2=byCoordinates_2, item3=byCoordinates_3)
byOrigin = CoordinateSystem.ByOrigin(origin=list_create)
code_block = CodeBlock { [50,15,7,8]; }
byWidthLength = Rectangle.ByWidthLength(cs=byOrigin, width=code_block, length=code_block)
deconstruct = List.Deconstruct(list=byWidthLength)

# group: Origin Point
byPatch = Surface.ByPatch(closedCurve=deconstruct.first)
in_uparameter_number_slider = DoubleSlider(0.35, range=0.01..0.99 step 0.01)  # graph input
in_vparameter_number_slider = DoubleSlider(0.21, range=0.01..0.99 step 0.01)  # graph input
pointAtParameter = Surface.PointAtParameter(surface=byPatch, u=in_uparameter_number_slider, v=in_vparameter_number_slider)

# group: Sample Points - Representing Area to test visibility
code_block_2 = CodeBlock { 15..24; }
code_block_3 = CodeBlock { -15..-24; }
byCoordinates_4 = Point.ByCoordinates(x=code_block_2, y=code_block_3, lacing=CrossProduct)
byCoordinates_5 = Point.ByCoordinates(x=code_block_3, y=code_block_2, lacing=CrossProduct)
list_create_2 = List.Create(item0=byCoordinates_4, item1=byCoordinates_5)
flatten = List.Flatten(list=list_create_2, lacing=Longest)

# group: Refinery Toolkit - Visibility of points from origin
ofPointsFromOrigin = Autodesk.RefineryToolkits.SpacePlanning.Analyze.Visibility.OfPointsFromOrigin(origin=pointAtParameter, points=flatten, boundary=deconstruct.first, obstructions=deconstruct.rest)
sum = Math.Sum(values=ofPointsFromOrigin.Percentage_visible)
OUT_VisiblePointsScore_MAX = Watch(sum)  # graph output

# group: Visualize visible points and lines
setDifference = List.SetDifference(list1=flatten, list2=ofPointsFromOrigin.Visible_items)
code_block_4 = CodeBlock { 50; }
byARGB = Color.ByARGB(alpha=code_block_4)
byGeometryColor = Modifiers.GeometryColor.ByGeometryColor(geometry=setDifference, color=byARGB)
byStartPointEndPoint = Line.ByStartPointEndPoint(startPoint=pointAtParameter, endPoint=ofPointsFromOrigin.Visible_items)
list_create_3 = List.Create(item0=ofPointsFromOrigin.Visible_items, item1=byStartPointEndPoint)
code_block_5 = CodeBlock { [255,50]; 255; }
byARGB_2 = Color.ByARGB(alpha=code_block_5.out0, blue=code_block_5.out1)
byGeometryColor_2 = Modifiers.GeometryColor.ByGeometryColor(geometry=list_create_3, color=byARGB_2)
