# Dynamo graph dt_GenerativeToolkit_GeometricMedianTest.dyn "dt_Refinery Toolkit_GeometricMedianTest" (Dynamo 2.3.0.4794)

# note: Variables / Inputs
# Green indicates Variables that can be altered per project and must be set accordingly before running the script.
# note: Working / Functions
# Orange indicates the working of the script. No changes should be made in these groups unless advised.
# note: Checking / Outputs
# Red indicates checking nodes to ensure the script has deployed correctly.

# group: REFINERY SPACE PLANNING TOOLKIT Geometric Median
# note: DYNAMO VERSION
# 2.0.2
# note: REQUIRED DYNAMO PACKAGES
# Refinery Toolkit
# note: ADDITIONAL COMMENTS
# note: DYNAMO PROJECT
# Refinery Toolkit
# note: ASSOCIATED FILE(S)
# N/A
# note: AUTHOR(S) / CREATION DATE
# designtech.io for Autodesk Refinery Team / April 2019
# note: DESCRIPTION
# This graph show examples of how the GeometricMedian node finds the point in a set of sample points, that minimizes the distance to all other points. The example shows this with different shaps and sample points.
# The GeometricMedian can be used to find the optimal location where the goal is to minimize distance to a set of objects.

# group: 50 Random points
code_block = CodeBlock { 50; }
randomList = Math.RandomList(amount=code_block)
code_block_2 = CodeBlock { 2; 50; }
remapRange = Math.RemapRange(numbers=randomList, newMin=code_block_2.out0, newMax=code_block_2.out1)
shuffle = List.Shuffle(list=remapRange)
byCoordinates = Point.ByCoordinates(x=remapRange, y=shuffle)

# group: Refinery Toolkit - Geometric Median
geometricMedian = Autodesk.RefineryToolkits.SpacePlanning.Analyze.AdjacencyPreference.GeometricMedian(points=byCoordinates)

# group: Obtuse Triangle
code_block_3 = CodeBlock { [70,95,130]; [20,12,-18]; }
byCoordinates_2 = Point.ByCoordinates(x=code_block_3.out0, y=code_block_3.out1)
byPoints = Polygon.ByPoints(points=byCoordinates_2)

# group: Refinery Toolkit - Geometric Median
geometricMedian_2 = Autodesk.RefineryToolkits.SpacePlanning.Analyze.AdjacencyPreference.GeometricMedian(points=byCoordinates_2)

# group: Acute Triangle
code_block_4 = CodeBlock { [70,95,80]; [50,42,18]; }
byCoordinates_3 = Point.ByCoordinates(x=code_block_4.out0, y=code_block_4.out1)
byPoints_2 = Polygon.ByPoints(points=byCoordinates_3)

# group: Refinery Toolkit - Geometric Median
geometricMedian_3 = Autodesk.RefineryToolkits.SpacePlanning.Analyze.AdjacencyPreference.GeometricMedian(points=byCoordinates_3)

# group: One of the four points is inside the triangle formed by the other three points
code_block_5 = CodeBlock { [70,95,80,60]; [80,72,48,90]; }
byCoordinates_4 = Point.ByCoordinates(x=code_block_5.out0, y=code_block_5.out1)
byPoints_3 = Polygon.ByPoints(points=byCoordinates_4)

# group: Refinery Toolkit - Geometric Median
geometricMedian_4 = Autodesk.RefineryToolkits.SpacePlanning.Analyze.AdjacencyPreference.GeometricMedian(points=byCoordinates_4)

# group: Convex Quadrilateral
code_block_6 = CodeBlock { [40,65,50,30]; [80,72,55,55]; }
byCoordinates_5 = Point.ByCoordinates(x=code_block_6.out0, y=code_block_6.out1)
byPoints_4 = Polygon.ByPoints(points=byCoordinates_5)

# group: Refinery Toolkit - Geometric Median
geometricMedian_5 = Autodesk.RefineryToolkits.SpacePlanning.Analyze.AdjacencyPreference.GeometricMedian(points=byCoordinates_5)

# group: Vizualize Geometric Median
list_create = List.Create(item0=geometricMedian, item1=geometricMedian_2, item2=geometricMedian_3, item3=geometricMedian_4, item4=geometricMedian_5)
code_block_7 = CodeBlock { 1; }
byCenterPointRadius = Circle.ByCenterPointRadius(centerPoint=list_create, radius=code_block_7, lacing=Longest)

# group: Visualize Lines
byStartPointEndPoint = Line.ByStartPointEndPoint(startPoint=geometricMedian, endPoint=byCoordinates, lacing=Longest)
code_block_8 = CodeBlock { 75; 255; 0; 0; }
byARGB = Color.ByARGB(a=code_block_8.out0, r=code_block_8.out1, g=code_block_8.out2, b=code_block_8.out3)
byGeometryColor = Modifiers.GeometryColor.ByGeometryColor(geometry=byStartPointEndPoint, color=byARGB)

# group: Visualize Lines
equals = List.Equals(objectA=byCoordinates_2@L1, objectB=geometricMedian_2)
filterByBoolMask = List.FilterByBoolMask(list=byCoordinates_2, mask=equals)
byStartPointEndPoint_2 = Line.ByStartPointEndPoint(startPoint=geometricMedian_2, endPoint=filterByBoolMask.out, lacing=Longest)
code_block_9 = CodeBlock { 75; 255; 0; 0; }
byARGB_2 = Color.ByARGB(a=code_block_9.out0, r=code_block_9.out1, g=code_block_9.out2, b=code_block_9.out3)
byGeometryColor_2 = Modifiers.GeometryColor.ByGeometryColor(geometry=byStartPointEndPoint_2, color=byARGB_2)

# group: Visualize Lines
byStartPointEndPoint_3 = Line.ByStartPointEndPoint(startPoint=geometricMedian_3, endPoint=byCoordinates_3, lacing=Longest)
code_block_10 = CodeBlock { 75; 255; 0; 0; }
byARGB_3 = Color.ByARGB(a=code_block_10.out0, r=code_block_10.out1, g=code_block_10.out2, b=code_block_10.out3)
byGeometryColor_3 = Modifiers.GeometryColor.ByGeometryColor(geometry=byStartPointEndPoint_3, color=byARGB_3)

# group: Visualize Lines
equals_2 = List.Equals(objectA=byCoordinates_4@L1, objectB=geometricMedian_4)
filterByBoolMask_2 = List.FilterByBoolMask(list=byCoordinates_4, mask=equals_2)
byStartPointEndPoint_4 = Line.ByStartPointEndPoint(startPoint=geometricMedian_4, endPoint=filterByBoolMask_2.out, lacing=Longest)
code_block_11 = CodeBlock { 75; 255; 0; 0; }
byARGB_4 = Color.ByARGB(a=code_block_11.out0, r=code_block_11.out1, g=code_block_11.out2, b=code_block_11.out3)
byGeometryColor_4 = Modifiers.GeometryColor.ByGeometryColor(geometry=byStartPointEndPoint_4, color=byARGB_4)

# group: Visualize Lines
byStartPointEndPoint_5 = Line.ByStartPointEndPoint(startPoint=geometricMedian_5, endPoint=byCoordinates_5, lacing=Longest)
code_block_12 = CodeBlock { 75; 255; 0; 0; }
byARGB_5 = Color.ByARGB(a=code_block_12.out0, r=code_block_12.out1, g=code_block_12.out2, b=code_block_12.out3)
byGeometryColor_5 = Modifiers.GeometryColor.ByGeometryColor(geometry=byStartPointEndPoint_5, color=byARGB_5)
