# Dynamo graph dt_GenerativeToolkit_IsovistFromPointTest.dyn (Dynamo 3.0.0.7040)
# packages: Refinery Toolkit for Space Planning 0.0.1

# note: Variables / Inputs
# Green indicates Variables that can be altered per project and must be set accordingly before running the script.
# note: Working / Functions
# Orange indicates the working of the script. No changes should be made in these groups unless advised.
# note: Checking / Outputs
# Red indicates checking nodes to ensure the script has deployed correctly.

# group: REFINERY SPACE PLANNING TOOLKIT Isovist from Point
# note: DYNAMO VERSION
# 3.0.0
# note: REQUIRED DYNAMO PACKAGES
# Refinery Toolkit
# note: ADDITIONAL COMMENTS
# note: DYNAMO PROJECT
# Refinery Toolkit
# note: ASSOCIATED FILE(S)
# N/A
# note: AUTHOR(S) / CREATION DATE
# designtech.io for Autodesk Refinery Team / April 2019
# note: DESCRIPTION
# This graph shows how to use the Isovist node from the REFINERY SPACE PLANNING TOOLKIT package.

# group: Create Layout
code_block = CodeBlock { [0,-10,15,5]; [0,5,-7,5]; }
byCoordinates = Point.ByCoordinates(x=code_block.out0, y=code_block.out1)
byOrigin = CoordinateSystem.ByOrigin(origin=byCoordinates)
code_block_2 = CodeBlock { [50,10,10,10]; [50,10,10,7]; }
byWidthLength = Rectangle.ByWidthLength(coordinateSystem=byOrigin, width=code_block_2.out0, length=code_block_2.out1)
deconstruct = List.Deconstruct(list=byWidthLength)

# group: Sample Point
byPatch = Surface.ByPatch(closedCurve=deconstruct.first)
number_slider = DoubleSlider(0.74, range=0..1 step 0.01)
number_slider_2 = DoubleSlider(0.92, range=0..1 step 0.01)
pointAtParameter = Surface.PointAtParameter(surface=byPatch, u=number_slider, v=number_slider_2)

# group: Refinery Toolkit - Isovist from point
isovistFromPoint = Autodesk.RefineryToolkits.SpacePlanning.Analyze.Visibility.IsovistFromPoint(point=pointAtParameter, boundary=deconstruct.first, obstructions=deconstruct.rest)
color_palette = ColorPalette({R: 0, G: 0, B: 255, A: 255})
byGeometryColor = Modifiers.GeometryColor.ByGeometryColor(geometry=isovistFromPoint, color=color_palette)
