# Dynamo graph dt_GenerativeToolkit_OpenessTest(RVT).dyn "dt_Refinery Toolkit_OpenessTest(RVT)" (Dynamo 2.0.2.6826)

# group: Get Desk point
family_types = FamilyTypes(index=24)
all_elements_of_family_type = ElementsOfFamilyType(Family_Type=family_types)
getLocation = Element.GetLocation(element=all_elements_of_family_type)

# group: Get object dimensions
elementType = Element.ElementType(element=all_elements_of_family_type)
code_block = CodeBlock { "Depth"; "Width"; }
getParameterValueByName = Element.GetParameterValueByName(element=elementType, parameterName=code_block.out1)
getParameterValueByName_2 = Element.GetParameterValueByName(element=elementType, parameterName=code_block.out0)

# group: Surface by object
byOrigin = CoordinateSystem.ByOrigin(origin=getLocation)
ZAxis = Vector.ZAxis()
getElementRotation = Custom[GetElementRotation](FamInstance=all_elements_of_family_type)  # Get the rotation of a family instance whose location is a point.
code_block_2 = CodeBlock(rotation=getElementRotation.Rotation) { -rotation; }
rotate = CoordinateSystem.Rotate(coordinateSystem=byOrigin, origin=getLocation, axis=ZAxis, degrees=code_block_2)
byWidthLength = Rectangle.ByWidthLength(cs=rotate, width=getParameterValueByName, length=getParameterValueByName_2)

byPatch = Surface.ByPatch(closedCurve=byWidthLength)

# group: Obstacles- Column Polygons
categories = Categories(index=122)
all_elements_of_category = ElementsOfCategory(Category=categories)
getLocation_2 = Element.GetLocation(element=all_elements_of_category)
byOrigin_2 = CoordinateSystem.ByOrigin(origin=getLocation_2)
type = archilab.Revit.Elements.Elements.Type(element=all_elements_of_category)
code_block_3 = CodeBlock { "Depth"; "Width"; }
getParameterValueByName_3 = Element.GetParameterValueByName(element=type, parameterName=code_block_3.out1)
getParameterValueByName_4 = Element.GetParameterValueByName(element=type, parameterName=code_block_3.out0)
byWidthLength_2 = Rectangle.ByWidthLength(cs=byOrigin_2, width=getParameterValueByName_3, length=getParameterValueByName_4)

# group: Obstacles- Wall Polygons
categories_2 = Categories(index=604)
all_elements_of_category_2 = ElementsOfCategory(Category=categories_2)
getLocation_3 = Element.GetLocation(element=all_elements_of_category_2)
type_2 = archilab.Revit.Elements.Elements.Type(element=all_elements_of_category_2)
code_block_4 = CodeBlock { "Width"; }
getParameterValueByName_5 = Element.GetParameterValueByName(element=type_2, parameterName=code_block_4)
direction = Line.Direction(line=getLocation_3)
byThickeningCurve = PolyCurve.ByThickeningCurve(curve=getLocation_3, thickness=getParameterValueByName_5, nor=direction)
curves = PolyCurve.Curves(polyCurve=byThickeningCurve)
startPoint = Curve.StartPoint(curve=curves)
byPoints = Polygon.ByPoints(points=startPoint)

join = List.Join(list0=byWidthLength_2, list1=byPoints)

# group: Refinery Toolkit - Openess From Point
fromSurface = Autodesk.RefineryToolkits.SpacePlanning.Analyse.Openess.FromSurface(surface=byPatch, obstacles=join)
watch = Watch(fromSurface)
