# Dynamo graph dt_GenerativeToolkit_OpenessTest.dyn (Dynamo 3.0.0.7040)
# packages: Refinery Toolkit 1.1.1

# note: Checking / Outputs
# Red indicates checking nodes to ensure the script has deployed correctly.

# group: REFINERY SPACE PLANNING TOOLKIT Openess
# note: DYNAMO VERSION
# 3.0.0
# note: REQUIRED DYNAMO PACKAGES
# Refinery Toolkit
# note: ADDITIONAL COMMENTS
# note: DYNAMO PROJECT
# Refinery Toolkit
# note: ASSOCIATED FILE(S)
# N/A
# note: AUTHOR(S) / CREATION DATE
# designtech.io for Autodesk Refinery Team / April 2019
# note: DESCRIPTION
# This graph shows how to use the REFINERY SPACE PLANNING TOOLKITs Openess Node.
# The Node returns the openess score of any surface. The score is calculated by checking how much of the object parameter is enclosed by any input obstacle. A tolerance can be set to check for intersection with elements with a fixed distance to the object.
# For example this can be used in a desk layout workflow to optimize the placement of desks, bu either minimizing or mazimizing the openess score.

# group: Create Object Location
# note: Variables / Inputs
# Green indicates Variables that can be altered per project and must be set accordingly before running the script.
X = DoubleSlider(-6.898, range=-8.716..100 step 0.1)
# note: Working / Functions
# Orange indicates the working of the script. No changes should be made in these groups unless advised.
Y = DoubleSlider(-1, range=-7.478..100 step 0.1)
origin_point_point_bycoordinates = Point.ByCoordinates(x=X, y=Y)
dimensions = CodeBlock { 2; 5; }
rotation = CodeBlock { 90; }

# group: Surface from of object
byOrigin = CoordinateSystem.ByOrigin(origin=origin_point_point_bycoordinates)
byWidthLength = Rectangle.ByWidthLength(coordinateSystem=byOrigin, width=dimensions.out0, length=dimensions.out1)
ZAxis = Vector.ZAxis()
rotate = Geometry.Rotate(geometry=byWidthLength, origin=origin_point_point_bycoordinates, axis=ZAxis, degrees=rotation)
byPatch = Surface.ByPatch(closedCurve=rotate)

# group: Layout
code_block = CodeBlock { [0,-10,15,5]; [0,5,-7,5]; }
byCoordinates = Point.ByCoordinates(x=code_block.out0, y=code_block.out1)
byOrigin_2 = CoordinateSystem.ByOrigin(origin=byCoordinates)
code_block_2 = CodeBlock { [50,10,10,10]; [50,10,10,7]; }
byWidthLength_2 = Rectangle.ByWidthLength(coordinateSystem=byOrigin_2, width=code_block_2.out0, length=code_block_2.out1)
deconstruct = List.Deconstruct(list=byWidthLength_2)

# group: Refinery Toolkit - Openess
fromSurface = Autodesk.RefineryToolkits.SpacePlanning.Analyze.Openess.FromSurface(surface=byPatch, boundary=deconstruct.rest, obstructions=deconstruct.first)
watch = Watch(fromSurface)
