# Dynamo graph dt_GenerativeToolkit_ShortestPathTest.dyn "dt_Refinery Toolkit_ShortestPathTest" (Dynamo 2.0.2.6826)

# note: Variables / Inputs
# Green indicates Variables that can be altered per project and must be set accordingly before running the script.
# note: Working / Functions
# Orange indicates the working of the script. No changes should be made in these groups unless advised.
# note: Checking / Outputs
# Red indicates checking nodes to ensure the script has deployed correctly.

# group: REFINERY SPACE PLANNING TOOLKIT Shortest Path
# note: DYNAMO VERSION
# 2.0.2
# note: REQUIRED DYNAMO PACKAGES
# Refinery Toolkit
# note: ADDITIONAL COMMENTS
# note: DYNAMO PROJECT
# Refinery Toolkit
# note: ASSOCIATED FILE(S)
# N/A
# note: AUTHOR(S) / CREATION DATE
# designtech.io for Autodesk Refinery Team / April 2019
# note: DESCRIPTION
# The shortest path node vil find the path with minimal travel distance between two points.

# group: Create Layout
number_slider = DoubleSlider(9.5, range=0..100 step 0.1)
number_slider_2 = DoubleSlider(7.7, range=0..100 step 0.1)
byCoordinates = Point.ByCoordinates(x=number_slider, y=number_slider_2)
number_slider_3 = DoubleSlider(23.571, range=0..100 step 0.1)
number_slider_4 = DoubleSlider(8.673, range=0..100 step 0.1)
byCoordinates_2 = Point.ByCoordinates(x=number_slider_3, y=number_slider_4)
number_slider_5 = DoubleSlider(-3.023, range=-3.023..100 step 0.1)
number_slider_6 = DoubleSlider(18.162, range=0..100 step 0.1)
byCoordinates_3 = Point.ByCoordinates(x=number_slider_5, y=number_slider_6)
number_slider_7 = DoubleSlider(3.923, range=0..100 step 0.1)
number_slider_8 = DoubleSlider(-0.859, range=-9.507..100 step 0.1)
byCoordinates_4 = Point.ByCoordinates(x=number_slider_7, y=number_slider_8)
list_create = List.Create(item0=byCoordinates, item1=byCoordinates, item2=byCoordinates_2, item3=byCoordinates_3, item4=byCoordinates_4)
byOrigin = CoordinateSystem.ByOrigin(origin=list_create)
code_block = CodeBlock { [50,15,7,8]; }
byWidthLength = Rectangle.ByWidthLength(cs=byOrigin, width=code_block, length=code_block)
deconstruct = List.Deconstruct(list=byWidthLength)

# group: Sample Points
number_slider_9 = DoubleSlider(0.182, range=-15.087..100 step 0.1)
number_slider_10 = DoubleSlider(-13.653, range=-17..24.62 step 0.0001)
origin_point_point_bycoordinates = Point.ByCoordinates(x=number_slider_9, y=number_slider_10)
number_slider_11 = DoubleSlider(25.171, range=-14.029..100 step 0.1)
number_slider_12 = DoubleSlider(25.8, range=-25..169.581 step 0.1)
destination_point_point = Point.ByCoordinates(x=number_slider_11, y=number_slider_12)

# group: Refinery Toolkit - ShortestPath
createVisibilityGraph = Autodesk.RefineryToolkits.SpacePlanning.Analyze.PathFinding.CreateVisibilityGraph(boundary=deconstruct.first, internals=deconstruct.rest)
shortestPath = Autodesk.RefineryToolkits.SpacePlanning.Analyze.PathFinding.ShortestPath(visGraph=createVisibilityGraph, origin=origin_point_point_bycoordinates, destination=destination_point_point)
lines = Autodesk.RefineryToolkits.SpacePlanning.Analyze.PathFinding.Lines(path=shortestPath.path)
