# Dynamo graph dt_GenerativeToolkit_Visibility_PointsTest.dyn "dt_Refinery Toolkit_Visibility_PointsTest" (Dynamo 2.0.2.6826)

# note: Working / Functions
# Orange indicates the working of the script. No changes should be made in these groups unless advised.
# note: Checking / Outputs
# Red indicates checking nodes to ensure the script has deployed correctly.

# group: REFINERY SPACE PLANNING TOOLKIT Visible Points
# note: DYNAMO VERSION
# 2.0.2
# note: REQUIRED DYNAMO PACKAGES
# Refinery Toolkit
# note: ADDITIONAL COMMENTS
# note: DYNAMO PROJECT
# Refinery Toolkit
# note: ASSOCIATED FILE(S)
# N/A
# note: AUTHOR(S) / CREATION DATE
# designtech.io for Autodesk Refinery Team / April 2019
# note: DESCRIPTION
# The VisiblePoints node will calculate the precentage of sample points that are visible from the origin point.
# For example this can be used to optimize the placement of any object that needs a high visibility to other objects or areas.

# group: Origin Point
number_slider = DoubleSlider(0.513, range=-15.087..100 step 0.1)
number_slider_2 = DoubleSlider(5.703, range=-31.196..39.728 step 0.0001)
byCoordinates = Point.ByCoordinates(x=number_slider, y=number_slider_2)

# group: Sample Points - Representing Area to test visibility
code_block = CodeBlock { 25..34; }
code_block_2 = CodeBlock { -17..-8; }
byCoordinates_2 = Point.ByCoordinates(x=code_block, y=code_block_2, lacing=CrossProduct)
flatten = List.Flatten(list=byCoordinates_2)

# group: Create Layout
number_slider_3 = DoubleSlider(9.5, range=0..100 step 0.1)
number_slider_4 = DoubleSlider(7.7, range=0..100 step 0.1)
byCoordinates_3 = Point.ByCoordinates(x=number_slider_3, y=number_slider_4)
number_slider_5 = DoubleSlider(23.571, range=0..100 step 0.1)
number_slider_6 = DoubleSlider(8.673, range=0..100 step 0.1)
byCoordinates_4 = Point.ByCoordinates(x=number_slider_5, y=number_slider_6)
number_slider_7 = DoubleSlider(-3.023, range=-3.023..100 step 0.1)
# note: Variables / Inputs
# Green indicates Variables that can be altered per project and must be set accordingly before running the script.
number_slider_8 = DoubleSlider(18.162, range=0..100 step 0.1)
byCoordinates_5 = Point.ByCoordinates(x=number_slider_7, y=number_slider_8)
list_create = List.Create(item0=byCoordinates_3, item1=byCoordinates_3, item2=byCoordinates_4, item3=byCoordinates_5)
byOrigin = CoordinateSystem.ByOrigin(origin=list_create)
code_block_3 = CodeBlock { [50,15,7,8]; }
byWidthLength = Rectangle.ByWidthLength(cs=byOrigin, width=code_block_3, length=code_block_3)
deconstruct = List.Deconstruct(list=byWidthLength)

# group: Refinery Toolkit - VisiblePoints.FromOrigin
ofPointsFromOrigin = Autodesk.RefineryToolkits.SpacePlanning.Analyze.Visibility.OfPointsFromOrigin(origin=byCoordinates, points=flatten, boundary=deconstruct.first, obstructions=deconstruct.rest)
watch = Watch(ofPointsFromOrigin.Percentage_visible)

# group: Visualize visible points and lines
setDifference = List.SetDifference(list1=flatten, list2=ofPointsFromOrigin.Visible_items)
code_block_4 = CodeBlock { 50; }
byARGB = Color.ByARGB(a=code_block_4)
byGeometryColor = Modifiers.GeometryColor.ByGeometryColor(geometry=setDifference, color=byARGB)
byStartPointEndPoint = Line.ByStartPointEndPoint(startPoint=byCoordinates, endPoint=ofPointsFromOrigin.Visible_items)
list_create_2 = List.Create(item0=ofPointsFromOrigin.Visible_items, item1=byStartPointEndPoint)
code_block_5 = CodeBlock { [255,50]; 255; }
byARGB_2 = Color.ByARGB(a=code_block_5.out0, b=code_block_5.out1)
byGeometryColor_2 = Modifiers.GeometryColor.ByGeometryColor(geometry=list_create_2, color=byARGB_2)
