# Dynamo graph Geometric median unit tests.dyn "geometric median test" (Dynamo 2.0.2.6826)

# group: 4 colinear points
n4_points_on_line = CodeBlock()  # "4 points on line"
# ---------- n4_points_on_line.designscript (6 lines) ----------
[
Point.ByCoordinates(260,600),
Point.ByCoordinates(285,600),
Point.ByCoordinates(310,600),
Point.ByCoordinates(335,600)
];
# ----------------------------------------
geometricMedian = Autodesk.RefineryToolkits.SpacePlanning.Analyze.AdjacencyPreference.GeometricMedian(points=n4_points_on_line)

# group: 6 colinear points
n6_points_on_line = CodeBlock()  # "6 points on line"
# ---------- n6_points_on_line.designscript (8 lines) ----------
[
Point.ByCoordinates(250,600),
Point.ByCoordinates(260,600),
Point.ByCoordinates(285,600),
Point.ByCoordinates(310,600),
Point.ByCoordinates(335,600),
Point.ByCoordinates(345,600)
];
# ----------------------------------------
geometricMedian_2 = Autodesk.RefineryToolkits.SpacePlanning.Analyze.AdjacencyPreference.GeometricMedian(points=n6_points_on_line)

# group: Equilateral triangle
equilateral_triangle = CodeBlock()
# ---------- equilateral_triangle.designscript (8 lines) ----------
[
Point.ByCoordinates(10,0),
Point.ByCoordinates(0,0),
Point.ByCoordinates(5,8.66)
];

// result should be
Point.ByCoordinates(5,2.887);
# ----------------------------------------
geometricMedian_3 = Autodesk.RefineryToolkits.SpacePlanning.Analyze.AdjacencyPreference.GeometricMedian(points=equilateral_triangle.out0)
byPoints = Polygon.ByPoints(points=equilateral_triangle.out0)
# note: These should be the same point
# (minus rounding errors)
center = Polygon.Center(polygon=byPoints)

# group: Acute triangle
acute_triangle = CodeBlock()
# ---------- acute_triangle.designscript (8 lines) ----------
[
Point.ByCoordinates(5,5),
Point.ByCoordinates(9.5,4.2),
Point.ByCoordinates(8,3)
];

// result should be
Point.ByCoordinates(7.997,3.311);
# ----------------------------------------
geometricMedian_4 = Autodesk.RefineryToolkits.SpacePlanning.Analyze.AdjacencyPreference.GeometricMedian(points=acute_triangle.out0)
byPoints_2 = Polygon.ByPoints(points=acute_triangle.out0)
# note: These should NOT be the same point
# (minus rounding errors)
center_2 = Polygon.Center(polygon=byPoints_2)

# group: Obtuse triangle
acute_triangle_2 = CodeBlock()
# ---------- acute_triangle_2.designscript (8 lines) ----------
[
Point.ByCoordinates(70,20),
Point.ByCoordinates(95,12),
Point.ByCoordinates(130,-18)
];

// result should be
Point.ByCoordinates(95,12);
# ----------------------------------------
geometricMedian_5 = Autodesk.RefineryToolkits.SpacePlanning.Analyze.AdjacencyPreference.GeometricMedian(points=acute_triangle_2.out0)
# note: These should be the same point
# (no rounding errors)
watch = Watch(acute_triangle_2.out1)
byPoints_3 = Polygon.ByPoints(points=acute_triangle_2.out0)
